# Grasshopper definition lsystem_demo.gh (Grasshopper 1.0.7)
# plug-ins: Hops

pi = Pi(Factor=1)
multiplication = Multiplication(A=pi, B=Slider(0.34, range=0..1))
number_slider = Slider(29, range=0..100)  # disabled
number_slider_2 = Slider(2.9, range=0..10)  # disabled
number_slider_3 = Slider(3, range=0..10)  # disabled
hops = Hops(
    Iterations=Slider(3, range=0..10),
    Angle=multiplication,
    Step=Slider(9, range=0..10),
    CacheResultsInMemory=True,
    CacheSolveResults=True,
    RemoteDefinitionLocation="http://localhost:5000/lsystem3d",
    RemoteSolveVersion=(0, 1, 0),
    ShowInput_Enabled=False,
    ShowInput_Path=False,
    SynchronousSolve=True)  # -> Points, Mesh
pt = Point(hops.Points)
mesh = Mesh(hops.Mesh)
hops_2 = Hops(
    Iterations=number_slider_3,
    Angle=number_slider,
    Step=number_slider_2,
    CacheResultsInMemory=True,
    CacheSolveResults=True,
    RemoteDefinitionLocation="http://localhost:5000/lsystem",
    RemoteSolveVersion=(0, 1, 0),
    ShowInput_Enabled=False,
    ShowInput_Path=False,
    SynchronousSolve=True)  # -> Points, Mesh; disabled
dispatch = Dispatch(List=pt, DispatchPattern=[True, False])  # -> ListA, ListB
pline = PolyLine(Vertices=dispatch.ListA, Closed=False)
mesh_2 = Mesh(hops_2.Mesh)  # disabled
pline_2 = PolyLine(Vertices=hops_2.Points, Closed=False)  # disabled
